# Grasshopper definition PachydermGrasshopper.gh (Grasshopper 1.0.7)
# plug-ins: PachydermGH, LunchBox

# Allgemeine Hinweise
# Ordnen Sie den Ebenen die entsprechenden Materialien zu.
# 
# Sperren Sie den Solver, bevor Sie Änderungen vornehmen, um das Initiieren der Simulation zu unterbinden. Alternativ können Sie auch die RayTracing-Komponente einzeln sperren.
# 
# Seien Sie geduldig, nach Anstoßen der Simulation antwortet die Software einige Zeit nicht.
# 
# Falls das Programm einige Minuten nicht antworten sollte, ohne Ergebnisse zu liefern, liegt vermutlich einer der folgenden Fehler vor:
# 
# - Materialien sind nicht den Ebenen zugeordnet
# - Anzahl der Rays für den PC zu hoch
# - Quellen und Empfänger sind nicht richtig definiert
# 
# Es kommt nicht auf Genauigkeit an!
# 
# Der Einfachheit halber wurde SPL anstelle des eigentlich passenderen Stärkemaßes verwendet.
# Tipps
# 1. Mittlere Maustaste!
# 
# 2. ALT-Rechts + Mausklick links auf die Komponente
# 
# 3. CTRL(+Shift) + Pfeil Links/Rechts um Verbindungen zwischen Komponenten nachverfolgen zu können.
# 
# 4. Doppelklick, dann "//" für Panels
# 
# 5. Display -> Draw full Names / Icons
panel_offset = Slider(-0.586, range=-1..-0.1)

# ---- group: Ceiling
# Aufgabe A (2P)
# Hinweis:
# 
# Verwenden Sie "<" um die ensprechenden Slider zu definieren.
# Verbinden Sie die Komponenten so, dass das Panel in einem Abstand von 1,0 bis 0,1 m zur Decke positioniert und die Fläche von 0 bis 100 % der Deckenfläche variiert werden können.
srf = Surface(<surface referenced from the Rhino model>)

# ----
panel_scaling = Slider(0.54, range=0..1)

# ----
# Panel
# Aufgabe B (1P)
# Verbinden Sie die Komponentetn so, dass das akustische Panel als bestandteil der Pachyderm Pylogon Scene verstanden und das passende akustische Material verwendet wird.
Z = UnitZ(Factor=panel_offset)
move = Move(Geometry=srf, Motion=Z)  # -> Geometry, Transform
area = Area(Geometry=move.Geometry)  # -> Area, Centroid
scale = Scale(Geometry=move.Geometry, Center=area.Centroid, Factor=panel_scaling)  # -> Geometry, Transform

# ----
# Room
toggle = BooleanToggle(True)
poly_scene = PolygonScene(RhinoGeometry=toggle, VoxelGridDepth=7)

# ---- group: Panel
# Aufgabe C (2P)
# Definieren Sie den Sitzbereich, indem Sie  der Surface-Komponente "SeatingArea" eine Referenz zur Fläche, die im Rhino-Projekt definiert ist und über einem Teil der Bodenfläche schwebt, hinzufügen.
brep = Brep(scale.Geometry)

# ---- group: SeatingArea
srf_2 = Surface(<surface referenced from the Rhino model>)

# ---- group: Source
pt = Point(Point(9, 6, 1.6))

# ----
# Erzeugen Sie im Sitzbereich 9 äquidistante Empfängerpositionen mithilfe der Grid-Komponente. Verbinden Sie die Komponenten so, dass Sie 9 valide Empfänger und eine Quelle für die anschließende Simulation haben.
# Sources & Receivers
grid = GridStructure(UDivisions=10, VDivisions=10)  # -> StructureLines, StructureNodes
geosrc = GeodesicSource(Power=[120, 120, 120, 120, 120, 120, 120, 120], Delay=0)
statrec = StationaryReceiver(RoomModel=poly_scene, SampleFrequency=44100, CutOffTime=1000)

# ---- group: Receivers
# Aufgabe D (1P)
# Verbinden Sie folgende Eingänge jeweils mit Slidern und stellen Sie sie auf die entpsrechenden Werte ein:
# 
# - Order bzw. IS_Order: 2
# - RayCt: 10.000
# - CO_Time: 2000
pt_2 = Point()

# ---- group: Room
data = Data(poly_scene)

# ----
# Simulation
pach_rt = RayTracing(RoomModel=data, Source=geosrc, Receiver=statrec, FrequencyScope=Domain(0, 7))  # disabled
# Hinweis:
# 
# Sperren Sie den Solver vor der Einstellung!
pach_ds = DirectSound(RoomModel=data, Source=geosrc, Receiver=statrec)
pach_is = ImageSource(RoomModel=data, Source=geosrc, Receiver=statrec, EdgeDiffraction=False)  # -> ImageSourceData, ReflectionTag, Reflections
etc = EnergyTimeCurve(DirectSound=pach_ds, ImageSource=pach_is.ImageSourceData, RayTracing=pach_rt)

# ----
# SPL
spl = SoundPressureLevel(EnergyTimeCurve=etc)
item = ListItem(List=spl, Index=0, Wrap=True)
avr = Average(Input=flatten(item))
panel = Panel(avr)

# ----
# Aufgabe E (2P)
# Stellen Sie die Komponenten unten so ein, dass C50 und SPL in den Oktavbändern für 500 und 1000 Hz berechnet wird.
# C50
c80 = Clarity(EnergyTimeCurve=etc, Early_Duration=80)
item_2 = ListItem(List=c80, Index=0, Wrap=True)
avr_2 = Average(Input=flatten(item_2))
# Aufgabe F (2P)
# Passen Sie die Höhe und Fläche des Panels sukzessive an, sodass ein guter Kompromiss aus Klarheitsmaß (C50) und außreichend hohem Schalldruckpegel (SPL)  gefunden werden kann.
panel_2 = Panel(avr_2)

# ----
# Maximize!
cluster = Cluster(A=avr_2, A_2=avr)
# Aufgabe G (2P)
# Hinweis:
# 
# Der Ausgangswert aus dem Cluster ist zu maxmieren und sollte idealerweise größer als 1 sein.
# 
# Sperren Sie den Solver vor der Einstellung!
# Erläutern Sie kurz, wie sich die Positionierung von Absorbern auf das Klarheits- und Stärkemaß auswirken können.
panel_3 = Panel(cluster)

# ==== cluster Cluster
A = ClusterInput()
c50 = Number(3.7)
A_2 = ClusterInput()
spl = Number(100)
division = Division(A=A, B=c50)
division_2 = Division(A=A_2, B=spl)
avr = Average(Input=[division, division_2])
roundd = RoundToDecimalPlace(NumberX=avr, DecimalPlace="2", RoundType=0)  # -> Rounded, Difference
x = ClusterOutput(roundd.Rounded)
